# Grasshopper definition indoor_and_outdoor_prototype.gh (Grasshopper 0.9.76)
# plug-ins: Python Interpreter, Human

# ---- group: I don't know what to call these
epsilonwallfunction = Butterfly_epsilonWallFunction(Cmu=0.09, kappa=0.4, E=9.8)  # -> epsilonWallFunction; plug-in component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
nutkwallfunction = Butterfly_nutkW4allFunction()  # -> nutkWallFunction; plug-in component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
kqrwallfunction = Butterfly_kqRWallFunction(value="0.01")  # -> kqRWallFunction; plug-in component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
fixedvalue = Butterfly_fixedValue(value="(0 0 0)")  # -> fixedValue; plug-in component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
calculated = Butterfly_calculated()  # -> calculated; plug-in component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
zerogradient = Butterfly_zeroGradient()  # -> zeroGradient; plug-in component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

# ----
panel = Panel(nutkwallfunction)

# ---- group: create your own
boundary = Butterfly_Boundary(bType="patch", U=zerogradient, p=zerogradient, k=zerogradient, epsilon=calculated, nut=calculated)  # -> readMe, boundary; plug-in component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

# ----
# Download and load butterfly!
panel_2 = Panel("C:\Users\Administrator\Documents\GitHub\Butterfly")
toggle = BooleanToggle(False)
wall = PythonScript(refLevels="(1, 2)")  # -> wallBC
# ---------- wall: Python ----------
from butterfly import boundarycondition
wallBC = boundarycondition.IndoorWallBoundaryCondition(refLevels=_refLevels_)
# ---------- end wall ----------
vec = VectorXYZ(XComponent="2", YComponent=0, ZComponent=0)  # -> Vector, Length
loadprobesfromproject = Butterfly_LoadProbesFromProject(name="indoor_temperature", field="T")  # -> values; plug-in component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

# ---- group: downloads and installs butterfly if it's not already installed!
butterfly = Butterfly(butterflyFolder=panel_2)  # -> swooooosh; "BF::BF"; plug-in component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

# ----
panel_3 = Panel("{3,1,2}")
# 0. Create BF surface
brep = Brep([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])
# 1. Wind Tunnel Parameters
jagged = SettingsSpeed()
inlet = Butterfly_InletBoundary(velocityVec=vec.Vector, refLevels="(1, 3)")  # -> inletBoundary; plug-in component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
panel_4 = Panel(loadprobesfromproject)
wall_2 = Butterfly_WallBoundary(refLevels="(1, 3)")  # -> wallBoundary; plug-in component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
outlet = Butterfly_OutletBoundary(refLevels="(1, 3)")  # -> outletBoundary; plug-in component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
createbfsurface = Butterfly_CreateButterflySurface(geo=brep, name="buildings", boundary=wall, meshSet=jagged)  # -> readMe, BFSrf; plug-in component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
# Outdoor Study
preview = CustomPreview(
    Geometry=brep,
    Shader={ambient=RGB(0, 0, 0), diffuse=RGB(255, 105, 180), emission=RGB(76, 32, 54), shine=0.5, specular=RGB(255, 255, 255), transparency=0})
windtunnelpar = Butterfly_WindTunnelParameters(windwardX=3, topX=3, sidesX=2, leewardX=15, nDivXYZ="{30,5,10}")  # -> readMe, tunnelPar; plug-in component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
panel_5 = Panel(butterfly)
number_slider = Slider(20, range=0..100)

inoutrefmode = Butterfly_LocationRefinementMode(mode=0, level=Slider(5, range=0..10))  # -> locationRefMode; plug-in component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
# Refinement Region
brep_2 = Brep(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)
jagged_2 = SettingsSpeed()
panel_6 = Panel(inoutrefmode)
refinementregion = Butterfly_RefinementRegion(geo=flatten(brep_2), name="ref_001", refMode=inoutrefmode, meshSet=jagged_2)  # -> readMe, refinementRegion; plug-in component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

brep_3 = Brep(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)
panel_7 = Panel("(1, 6)")

# ---- group: inlet!
srf = Surface(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)

# ----
jagged_3 = SettingsSpeed()
srf_2 = Surface(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)
number_slider_2 = Slider(10, range=0..10)
vec_2 = Vector(Vector(47.94345108, 59.67856447, 0))
wires = BrepWireframe(Brep=brep_3, Density=-1)
# Indoor Study
area = Area(Geometry=srf)  # -> Area, Centroid
distrefmode = Butterfly_DistanceRefinementMode(levels_0="(1, 5)", levels_1="(2, 3)")  # -> distanceRefMode; plug-in component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
# 2. Create the Wind Tunnel
panel_8 = Panel("6.0")
vdis = VectorDisplay(Anchor=Point(0, 0, 0), Vector=vec_2)
preview_2 = CustomPreview(Geometry=[srf_2, srf], Shader=ColourSwatch(SwatchColor=RGBA(136, 191, 255, 77)))
# 0. Create BF surfaces
vdis_2 = VectorDisplay(Anchor=area.Centroid, Vector=vec.Vector)
box = DomainBox(Base=PlaneXY(0, 0, 0), X=number_slider_2, Y=number_slider_2, Z=number_slider_2)
createcasefromtunnel = Butterfly_CreateCaseFromTunnel(
    name="outdoor_t_1",
    BFSurfaces=createbfsurface.BFSrf,
    windSpeed=panel_8,
    refWindHeight=10,
    landscape=1,
    tunnelPar=windtunnelpar.tunnelPar,
    run=Toggle(True))  # -> readMe, geo, case; plug-in component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
panel_9 = Panel(distrefmode)
wires_2 = BrepWireframe(Brep=brep_2, Density=-1)
blockmeshdict = Butterfly_blockMeshDict(bbox=box, nDivXYZ="{4,4,4}", gradXYZ="{1,1,1}")  # -> blockMeshDict; plug-in component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
createbfsurface_2 = Butterfly_CreateButterflySurface(geo=flatten(srf_2), name="east_window", boundary=outlet, meshSet=jagged_3)  # -> readMe, BFSrf; plug-in component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
createbfsurface_3 = Butterfly_CreateButterflySurface(geo=brep_3, name="room", boundary=wall_2, meshSet=jagged_3)  # -> readMe, BFSrf; plug-in component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
createbfsurface_4 = Butterfly_CreateButterflySurface(geo=srf, name="west_window", boundary=inlet, meshSet=jagged_3)  # -> readMe, BFSrf; plug-in component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
panel_10 = Panel(createcasefromtunnel.readMe)
previewlw = CustomPreviewLineweights(
    Geometry=wires_2,
    Shader={ambient=RGB(0, 0, 0), diffuse=RGB(255, 105, 180), emission=RGB(76, 32, 54), shine=0.5, specular=RGB(255, 255, 255), transparency=0},
    Thickness=Slider(3, range=0..10),
    Absolute=False)
# 1. Create an OpenFOAM case
panel_11 = Panel("indoor_airflow_b")
panel_12 = Panel("C:\Users\Administrator\Documents\GitHub\Butterfly")
panel_13 = Panel("C:\Users\Administrator\Documents\GitHub\Butterfly\plugin\grasshopper")
dom = ConstructDomain(DomainStart="1", DomainEnd="2")
loadprobesfromproject_2 = Butterfly_LoadProbesFromProject()  # -> values; plug-in component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

# ---- group: Create and write the case!
createcasefromsurfaces = Butterfly_CreateCaseFromSurfaces(
    name=panel_11,
    BFSurfaces=flatten([createbfsurface_3.BFSrf, createbfsurface_4.BFSrf, createbfsurface_2.BFSrf]),
    blockMeshDict=blockmeshdict,
    globalRefLevel=dom,
    refRegions=refinementregion.refinementRegion,
    run=Toggle(False))  # -> readMe, case; plug-in component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

# ----
exportladybug = Ladybug_ExportLadybug(targetFolder=panel_13, export=Toggle(False))  # -> readMe; plug-in component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
panel_14 = Panel(exportladybug)
pt = Point([Point(1.933395533, 5.160314456, 1.966949468), Point(7.958785718, 6.157761352, 2.624808354)])
panel_15 = Panel(pt)
toggle_2 = BooleanToggle(False)
# purgeCase
purgecase = Butterfly_purgeCase(case=createcasefromsurfaces.case, blockMesh=toggle_2, snappyHexMesh=toggle_2, results=toggle_2)  # -> readMe; plug-in component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
# Mesh and run the case
pt_2 = Point(<point referenced from the Rhino model>)
python = PythonScript()
panel_16 = Panel("""simulationType		RAS;


RAS
{

    printCoeffs		on;

    RASModel		RNGkEpsilon;
turbulance""")

# ---- group: recipe
python_2 = PythonScript(_turbulenceModel_=python)  # -> Out, Recipe

# ----
brep_4 = Brep([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])
python_3 = PythonScript(geo=brep_4, nDivXYZ="{1,1,1}", gradXYZ="{1,1,1}")  # -> out, block; inputs geo: Brep, nDivXYZ: Point3d, gradXYZ: Point3d; disabled
# ---------- python_3: Python ----------
import sys
sys.path.append("C:/Users/Administrator/Dropbox/ladybug/Butterfly")

import butterfly
from butterfly.gh import Block

reload(butterfly)
reload(butterfly.gh)

block = Block(geo, nDivXYZ, gradXYZ)
# ---------- end python_3 ----------
wires_3 = BrepWireframe(Brep=brep_4, Density=-1)
python_4 = PythonScript(name="innerflow_2", blocks=python_3.block)  # -> out, c; inputs BFSrfs: list, blocks: list; disabled
# ---------- python_4: Python ----------
import sys
sys.path.append("C:/Users/Administrator/Dropbox/ladybug/Butterfly")

import butterfly
from butterfly.foamfile import FoamFile
from butterfly.core import Case

reload(butterfly)
reload(butterfly.blockMeshDict)
reload(butterfly.foamfile)
reload(butterfly.core)

c = Case.fromBlocks(BFSrfs, blocks, 1)
c.write(name)
# ---------- end python_4 ----------
panel_17 = Panel(python_4.out)

brep_5 = Brep([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])
gentestpts = Honeybee_GenerateTestPoints(testGeometry=brep_5, gridSize=Slider(0.5, range=0..1), distBaseSrf="0.05", moveTestMesh=Toggle(False))  # -> readMe, simplify(testPoints), simplify(ptsVectors), simplify(facesArea), simplify(mesh); plug-in component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
flatten = FlattenTree(Tree=gentestpts.testPoints, Path="{0}")
faceb = FaceBoundaries(Mesh=gentestpts.mesh)
panel_18 = Panel("C:\Users\Administrator\butterfly\atrium2d\3\polyMesh")

panel_19 = Panel("C:\Users\Administrator\Dropbox\ladybug\Butterfly\other_files\OpenFOAM_Sample_Files\innerflow\constant\polyMesh")
python_5 = PythonScript()  # -> out, mesh
# ---------- python_5: Python ----------
import Rhino as rc
import os

def splitLine(l, t=float):
    return tuple(t(s) for s in l.split('(')[-1].replace(')', '').split())

def OFMeshToRhino(studyFolder):
    if not studyFolder:
        return

    pf = os.path.join(studyFolder, 'points')
    ff = os.path.join(studyFolder, 'faces')
    
    if not os.path.isfile(pf) or not os.path.isfile(ff):
        print "Can't find point and faces file."
        return
        
    # read points
    with open(pf, 'rb') as ptFile:
        for l in xrange(17):
            ptFile.readline()
        
        try:
            # blockMesh
            line = ptFile.readline()
            nPoints = int(line[0])
            pts = tuple(
                       rc.Geometry.Point3d(*pt)
                       for pt in eval(line[1:].replace(" ", ", "))
                       )
        except:
            #snappyHexMesh
            line = ptFile.readline()
            nPoints = int(line)
            ptFile.readline()
            pts = tuple(
                       rc.Geometry.Point3d(*splitLine(ptFile.readline()))
                       for pt in xrange(nPoints)
                )

            
    # read faces
    with open(ff, 'rb') as faceFile:
       for l in xrange(18):
           faceFile.readline()
       
       nFaces = int(faceFile.readline())
       faceFile.readline()
       faces = tuple((splitLine(faceFile.readline(), t=int))
                   for pt in xrange(nFaces)
            )
    
    # create the mesh
    mesh = rc.Geometry.Mesh()

    for p in pts:
        mesh.Vertices.Add(p)

    for face in faces:
        if len(face) < 5:
            mesh.Faces.AddFace(*face)
        elif len(face) == 5:
            mesh.Faces.AddFace(*face[:3])
            mesh.Faces.AddFace(*face[:1] + (face[3:]))
        elif len(face) == 8:
            mesh.Faces.AddFace(*face[:4])
            mesh.Faces.AddFace(*(face[0], face[3], face[4], face[7]))
            mesh.Faces.AddFace(*(face[7], face[4], face[5], face[6]))
        else:
            try:
                mesh.Faces.AddFace(*face[:4])
                mesh.Faces.AddFace(*face[:1] + (face[4:]))
            except:
                msg = "One of the faces has %d vertices." % len(face)
                print msg

    return mesh

mesh = OFMeshToRhino(studyFolder)
# ---------- end python_5 ----------
pt_3 = Point(Point(5.246792205, 3.706414975, 3.184472171))
xz = XZPlane(Origin=pt_3)
xy = XYPlane(Origin=pt_3)
yz = YZPlane(Origin=pt_3)
mesh = Mesh(python_5.mesh)
sec = MeshPlane(Mesh=mesh, Plane=xy)

panel_20 = Panel("C:\Users\Administrator\butterfly\innerflow_3\constant\polyMesh")
number_slider_3 = Slider(2000, range=0..10000)

# ----
# 0. blockMesh
# 1. snappyHexMesh
# 2. simpleFOAM
# This will eventually change to a recipe,
toggle_3 = BooleanToggle(True)
snappyhexmeshdict = Butterfly_snappyHexMeshDict(castellatedMesh=True, snap=True, addLayers=False, maxGlobalCells=2000000)  # -> snappyHexMeshDict; plug-in component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
blockmesh = Butterfly_blockMesh(case=createcasefromtunnel.case, purge=toggle_3, run=Toggle(False))  # -> readMe, case; plug-in component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
snappyhexmesh = Butterfly_snappyHexMesh(case=blockmesh.case, locationInMesh=pt_2, run=Toggle(False))  # -> out, case; plug-in component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
panel_21 = Panel("""U
p""")
residualcontrol = Butterfly_residualControl(p="0.0001", U="0.0001", k="0.0001", epsilon="0.0001")  # -> residualControl; plug-in component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
probes = Butterfly_probes(pts=flatten, fields=panel_21)  # -> probes; plug-in component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
controldict = Butterfly_controlDict(startTime=0, endTime=Slider(100, range=0..100), writeInterval=100, writeCompression=False)  # -> controlDict; plug-in component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

# ----
# 1.1. checkMesh
chekmesh = Butterfly_chekMesh(case=snappyhexmesh.case, run=Toggle(False))  # -> readMe, case, maxNonOrthogonality; plug-in component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
# 1.2. update fvSchemes based on
# mesh orthogonality
updatefvschemes = Butterfly_UpdateFvSchemes(case=chekmesh.case, orthogonality=chekmesh.maxNonOrthogonality, run=Toggle(True))  # -> readMe, case; plug-in component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

# ---- group: case
# Load mesh,
# points, results
data = Data(blockmesh.case)

# ----
python_6 = PythonScript(case=data, load=Toggle(False))  # -> velocityVectors; inputs load: Boolean
# ---------- python_6: Python ----------
if case and load:
    velocityVectors = case.loadVelocity()
# ---------- end python_6 ----------
loadmesh = Butterfly_LoadMesh(case=data, load=Toggle(True))  # -> mesh; plug-in component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
loadpoints = Butterfly_LoadPoints(case=data, load=Toggle(False))  # -> pts; plug-in component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
pt_4 = Point(<point referenced from the Rhino model>)
pt_5 = Point(<point referenced from the Rhino model>)
xy_2 = XYPlane(Origin=pt_4)
xz_2 = XZPlane(Origin=pt_5)

# ---- group: execute the case - simpleFoam for now
simplefoam = Butterfly_simpleFoam(case=updatefvschemes.case, controlDict=controldict, residualControl=residualcontrol, probes=probes, run=Toggle(False))  # -> readMe, case; plug-in component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

# ----
sec_2 = MeshPlane(Plane=[xz_2, xy_2])
panel_22 = Panel("C:\Users\Administrator\butterfly\indoor_airflow_3\constant\polyMesh")
panel_23 = Panel("C:\Users\Administrator\butterfly\indoor_airflow_3\1900")
data_2 = Data(simplefoam.case)
panel_24 = Panel(controldict)
python_7 = PythonScript()  # -> vectors
# ---------- python_7: Python ----------
import Rhino as rc
import os

def splitLine(l, t=float):
    return tuple(t(s) for s in l.split('(')[-1].replace(')', '').split())


def loadVectors(studyFolder):
    pf = os.path.join(studyFolder, 'U')
    
    if not os.path.isfile(pf):
        print "Can't find vector file."
        return
        
    # read vectors
    with open(pf, 'rb') as ptFile:
        for l in xrange(21):
            line = ptFile.readline()       
        nVectors = int(line)
        ptFile.readline()
        vectors = tuple(
                   rc.Geometry.Vector3d(*splitLine(ptFile.readline()))
                   for pt in xrange(nVectors)
            )
    return vectors

vectors = loadVectors(studyFolder)
# ---------- end python_7 ----------
python_8 = PythonScript()  # -> pts
# ---------- python_8: Python ----------
import Rhino as rc
import os

def splitLine(l, t=float):
    return tuple(t(s) for s in l.split('(')[-1].replace(')', '').split())


def loadPoints(studyFolder):
    pf = os.path.join(studyFolder, 'points')
    
    if not os.path.isfile(pf):
        print "Can't find point and faces file."
        return
        
    # read points
    with open(pf, 'rb') as ptFile:
        for l in xrange(17):
            ptFile.readline()
        
        try:
            # blockMesh
            line = ptFile.readline()
            nPoints = int(line[0])
            pts = tuple(
                       rc.Geometry.Point3d(*pt)
                       for pt in eval(line[1:].replace(" ", ", "))
                       )
        except:
            #snappyHexMesh
            line = ptFile.readline()
            nPoints = int(line)
            ptFile.readline()
            pts = tuple(
                       rc.Geometry.Point3d(*splitLine(ptFile.readline()))
                       for pt in xrange(nPoints)
                )

    return pts

pts = loadPoints(studyFolder)
# ---------- end python_8 ----------
loadprobesfromproject_3 = Butterfly_LoadProbesFromProject(field="p")  # -> values; plug-in component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
loadprobes = Butterfly_LoadProbes(case=data_2, field="p")  # -> skippedPoints, values; plug-in component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
loadprobes_2 = Butterfly_LoadProbes(case=data_2, field="U")  # -> skippedPoints, values; plug-in component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
loadprobesfromproject_4 = Butterfly_LoadProbesFromProject(field="U")  # -> values; plug-in component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

# ---- group: vectors
vec_3 = Vector(loadprobesfromproject_4)

# ---- group: points
pt_6 = Point(flatten)

# ----
vlen = VectorLength(Vector=vec_3)
bnd = Bounds(Numbers=vlen)
scale = Slider(0.27, range=0..1)
remap = RemapNumbers(Value=vlen, Source=bnd, Target=Domain(1, 0))  # -> Mapped, Clipped
gradient = Gradient(
    LowerLimit=0,
    UpperLimit=1,
    Parameter=remap.Mapped,
    stops=[0: RGB(234, 38, 0), 0.25: RGB(234, 126, 0), 0.5: RGB(254, 244, 84), 0.75: RGB(173, 203, 249), 1: RGB(75, 107, 169)])
multiplication = Multiplication(A=vec_3, B=scale)
vdisex = VectorDisplayEx(Point=pt_6, Vector=multiplication, Colour=gradient, Width=Slider(2, range=0..5))

# ----
# Results visualization
flatten_2 = FlattenTree(Tree=gentestpts.mesh, Path="{0}")
mjoin = MeshJoin(Meshes=flatten_2)
ladybug = Ladybug_Ladybug()  # -> Vviiiiiiiiiizzz; plug-in component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
recolormesh = Ladybug_RecolorMesh(analysisResult=loadprobesfromproject_3, inputMesh=mjoin, analysisTitle="pressure", legendTitle="Pa")  # -> readMe, newMesh, newLegend, legendBasePt, meshColors, legendColors; plug-in component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
